# Dynamo graph Google Charts - Pie Chart.dyn (Dynamo 1.3.1.1736)

# group: Set external CSS
string = StringInput("https://maxcdn.bootstrapcdn.com/bootstrap/3.3.7/css/bootstrap.min.css")
create = List.Create(string)

# group: Set external javascript
string_2 = StringInput("https://ajax.googleapis.com/ajax/libs/jquery/3.2.0/jquery.min.js")
string_3 = StringInput("https://maxcdn.bootstrapcdn.com/bootstrap/3.3.7/js/bootstrap.min.js")
string_4 = StringInput("https://www.gstatic.com/charts/loader.js")
create_2 = List.Create(string_2, string_3, string_4)

string_5 = StringInput("<div id=\"chart_div\" class=\"chart\"></div>")
categories = Categories("DuctCurves")
string_from_object = FromObject(categories)

# group: Create data table
code_block = CodeBlock { ""; }
string_6 = StringInput("data.addColumn('string', '")
string_7 = StringInput("');\n")
string_8 = StringInput("data.addColumn('number', 'Slices');")
join = String.Join(code_block, string_6, string_from_object, string_7, string_8)
watch = Watch(join)

# group: Get count of all family types of a category
all_placed_family_types_of = Custom[All Placed Family Types of Category](category=categories)  # Retrieves all family types of a given category that have *placed* instances
name = FamilyType.Name(all_placed_family_types_of)
boolean = BoolSelector(true)
all_elements_of_family_type = Custom[All Elements of Family Type (Universal)](familyType=all_placed_family_types_of, toggle=boolean)  # Unlike the built-in node, this node retrieves all placed instances of a given loadable *or* system family type
python_count_all_family_types = Python(IN[0]=name, IN[1]=all_elements_of_family_type)
# ---------- python_count_all_family_types.python (15 lines) ----------
import clr
clr.AddReference('ProtoGeometry')
from Autodesk.DesignScript.Geometry import *
#The inputs to this node will be stored as a list in the IN variables.
familyTypes = IN[0]
elements = IN[1]

listCounts = {}

for index1, i in enumerate(familyTypes):
	for index2, i in enumerate(familyTypes):
		listCounts[str(familyTypes[index1])] = len(elements[index1])

#Assign your output to the OUT variable.
OUT = listCounts.items()
# ----------------------------------------
watch_2 = Watch(python_count_all_family_types)
watch_3 = Watch(all_elements_of_family_type)

# group: Create rows for JavaScript
python_add_js_rows = Python(IN[0]=watch_2)
# ---------- python_add_js_rows.python (13 lines) ----------
import clr
clr.AddReference('ProtoGeometry')
from Autodesk.DesignScript.Geometry import *
#The inputs to this node will be stored as a list in the IN variables.
dictIn = IN[0]

javaScript = ""

for index, i in enumerate(dictIn):
	javaScript += str(dictIn[index]) + ",\n"
javaScript = javaScript[:-2] + "\n"
#Assign your output to the OUT variable.
OUT = javaScript
# ----------------------------------------
watch_4 = Watch(python_add_js_rows)

python_javascript_for_chart = Python(IN[0]=watch, IN[1]=watch_4, IN[2]=string_from_object)
# ---------- python_javascript_for_chart.python (30 lines) ----------
import clr
clr.AddReference('ProtoGeometry')
from Autodesk.DesignScript.Geometry import *
#The inputs to this node will be stored as a list in the IN variables.
dataTable = IN[0]
rowsIn = IN[1]
chartTitle = IN[2]

html =""

# Begin JS code
html += '<script type="text/javascript">\n' + "google.charts.load('current', {'packages':['corechart']});\n" + "google.charts.setOnLoadCallback(drawChart);\n" + "function drawChart() {\n" + "var data = new google.visualization.DataTable();\n"

# Add data
html += dataTable
html += "\ndata.addRows(["
html += rowsIn

# Close data
html += "]);\n"

# Add options
html += "var options = {'title':'" + chartTitle + "','width':800, 'height':800};\n"
html += "var chart = new google.visualization.PieChart(document.getElementById('chart_div')); chart.draw(data, options); }"

# End JS code
html += "</script>"

#Assign your output to the OUT variable.
OUT = html
# ----------------------------------------
watch_5 = Watch(python_javascript_for_chart)
string_9 = StringInput("""
<style>
</style>""")
concat = String.Concat(watch_5, string_9)

# group: Create HTML filename from category
string_10 = StringInput(".\")
string_11 = StringInput(" ")
string_12 = StringInput("%20")
replace = String.Replace(str=string_from_object, searchFor=string_11, replaceWith=string_12)
string_13 = StringInput(".html")
concat_2 = String.Concat(string_10, replace, string_13)

# group: Write to external HTML file
generate_web_page = Custom[Generate Web Page](stylesheetSrc=create, javaScriptSrc=create_2, content=string_5, embeddedHeadCode=concat)  # Creates a static web page from a string formatted as HTML.
watch_6 = Watch(generate_web_page)
writeText = File.WriteText(concat_2, generate_web_page)
